# Dynamo graph project_v1.dyn (Dynamo 2.15.2.6417)

file_path = Filename(".\testing.xlsx")
file_from_path = FileObject(path=file_path)
code_block = CodeBlock { "Sheet1"; false; }
importExcel = Data.ImportExcel(file=file_from_path, sheetName=code_block.out0, readAsStrings=code_block.out1, showExcel=code_block.out1)
flatten = List.Flatten(list=importExcel)
watch = Watch(flatten)
magic = Python(IN[0]=watch)  # CPython3
# ---------- magic.python (70 lines) ----------
# Load the Python Standard and DesignScript Libraries
import sys
import clr

clr.AddReference('ProtoGeometry')
from Autodesk.DesignScript.Geometry import *

# The inputs to this node will be stored as a list in the IN variables.
data = IN[0]
width = data[3]
height = data[5]
span = data[7]
l = []

def round_to_multiple(number, multiple):
    return multiple * round(number / multiple)
    
d = height/1.732 # d = height/tan(60)
ts = round_to_multiple((span - 2*d),2*d) # top span (adjusted as per the height in order to maintain equilateral triangles)

p1 = Point.ByCoordinates(-span/2,-width/2,0) #end 1 bottom
p2 = Point.ByCoordinates(-span/2,width/2,0) #end 1 bottom
p3 = Point.ByCoordinates(span/2,-width/2,0) #end 2 bottom
p4 = Point.ByCoordinates(span/2,width/2,0) #end 2 bottom


p5 = Point.ByCoordinates(-ts/2,-width/2,height) #end 1 top
p6 = Point.ByCoordinates(-ts/2,width/2,height) #end 1 top
p7 = Point.ByCoordinates(ts/2,-width/2,height) #end 2 top
p8 = Point.ByCoordinates(ts/2,width/2,height) #end 2 top
#connecting bottom lines
l.append(Line.ByStartPointEndPoint(p1,p3))
l.append(Line.ByStartPointEndPoint(p2,p4))
l.append(Line.ByStartPointEndPoint(p1,p2))
l.append(Line.ByStartPointEndPoint(p3,p4))


for i in range(0,int(ts/(2*d))):
    p_top1 = Point.ByCoordinates(-ts/2+i*2*d,-width/2,height)
    p_bot1 = Point.ByCoordinates(-ts/2+(i*2+1)*d,-width/2,0)
    l.append(Line.ByStartPointEndPoint(p_top1, p_bot1))
    p_top2 = Point.ByCoordinates(-ts/2+i*2*d,width/2,height)
    p_bot2 = Point.ByCoordinates(-ts/2+(i*2+1)*d,width/2,0)
    l.append(Line.ByStartPointEndPoint(p_top2, p_bot2))
    l.append(Line.ByStartPointEndPoint(p_top2, p_top1))
    l.append(Line.ByStartPointEndPoint(p_bot1, p_bot2))

for i in range(1,int(ts/(2*d))+1):
    p_top1 = Point.ByCoordinates(-ts/2+i*2*d,-width/2,height)
    p_bot1 = Point.ByCoordinates(-ts/2+(i*2-1)*d,-width/2,0)
    l.append(Line.ByStartPointEndPoint(p_top1, p_bot1))
    p_top2 = Point.ByCoordinates(-ts/2+i*2*d,width/2,height)
    p_bot2 = Point.ByCoordinates(-ts/2+(i*2-1)*d,width/2,0)
    l.append(Line.ByStartPointEndPoint(p_top2, p_bot2))
    l.append(Line.ByStartPointEndPoint(p_top2, p_top1))
    l.append(Line.ByStartPointEndPoint(p_bot1, p_bot2))

#connecting top lines
l.append(Line.ByStartPointEndPoint(p5,p7))
l.append(Line.ByStartPointEndPoint(p6,p8))
l.append(Line.ByStartPointEndPoint(p5,p6))
l.append(Line.ByStartPointEndPoint(p7,p8))
#connecting top and bottom ends
l.append(Line.ByStartPointEndPoint(p1,p5))
l.append(Line.ByStartPointEndPoint(p2,p6))
l.append(Line.ByStartPointEndPoint(p3,p7))
l.append(Line.ByStartPointEndPoint(p4,p8))

# Assign your output to the OUT variable.
OUT = l
# ----------------------------------------
